# Dynamo graph codice-6-1-dynamo-piano.dyn "cap-6-1-dynamo-piano" (Dynamo 2.13.1.3887)
# Il piano: quota +4.00 orizzontale e la distanza del punto Q (z=4.05): 0.05 m. Palestra del capitolo 6.1; si apre anche in Dynamo Sandbox.

code_block = CodeBlock { Point.ByCoordinates(0, 0, 4); Vector.ZAxis(); Point.ByCoordinates(32.4, 18.2, 4.05); }
byOriginNormal = Plane.ByOriginNormal(origin=code_block.out0, normal=code_block.out1)
distanceTo = Geometry.DistanceTo(geometry=byOriginNormal, other=code_block.out2)
watch = Watch(distanceTo)
