# Dynamo graph codice-6-1-dynamo-punto.dyn "cap-6-1-dynamo-punto" (Dynamo 2.13.1.3887)
# Il punto: gli estremi dell'asse della EC-01 e la distanza fra loro (12 m). Palestra del capitolo 6.1; si apre anche in Dynamo Sandbox.

code_block = CodeBlock { Point.ByCoordinates(27.204, 15.2, 4); Point.ByCoordinates(37.596, 21.2, 4); }
distanceTo = Geometry.DistanceTo(geometry=code_block.out0, other=code_block.out1)
watch = Watch(distanceTo)
