# Dynamo graph codice-6-1-dynamo-sfera.dyn "cap-6-1-dynamo-sfera" (Dynamo 2.13.1.3887)
# La sfera di contenimento della EC-01 (centro nel punto medio, raggio 6) e il punto Q a 2.72 dal centro: dentro. Palestra del capitolo 6.1; si apre anche in Dynamo Sandbox.

code_block = CodeBlock { Point.ByCoordinates(32.4, 18.2, 4); 6; Point.ByCoordinates(35, 19, 4); }
byCenterPointRadius = Sphere.ByCenterPointRadius(centerPoint=code_block.out0, radius=code_block.out1)
distanceTo = Geometry.DistanceTo(geometry=code_block.out0, other=code_block.out2)
watch = Watch(distanceTo)
