# Dynamo graph codice-7-1-dynamo.dyn (Dynamo 3.3.0.6316)
# Furação no Dynamo - o clash exato: os sólidos dos eletrodutos escolhidos contra as estruturas do link, DirectShape para a coordenação

# group: 1 - Os eletrodutos escolhidos, em geometria
select_model_elements = DSModelElementMultipleSelection()  # nothing selected
geometry = Element.Geometry(element=select_model_elements)

# group: 2 - O link e a triagem por caixas
select_model_element = DSModelElementSelection()  # nothing selected
as_estruturas_próximas_python = Python(IN[0]=select_model_element, IN[1]=select_model_elements)  # CPython3
# ---------- as_estruturas_próximas_python.python (64 lines) ----------
# As estruturas do link próximas aos eletrodutos escolhidos, no nosso mundo.
# A triagem por caixas (Parte 6) vive aqui: só se convertem os
# sólidos que podem tocar os eletrodutos, não o link inteiro.
import clr
clr.AddReference('RevitAPI')
from Autodesk.Revit.DB import (FilteredElementCollector,
    BuiltInCategory, Options, Solid, GeometryInstance, XYZ)
clr.AddReference('RevitNodes')
import Revit
clr.ImportExtensions(Revit.GeometryConversion)

link   = UnwrapElement(IN[0])          # RevitLinkInstance
scelti = [UnwrapElement(e) for e in IN[1]]
ldoc = link.GetLinkDocument()
tr   = link.GetTotalTransform()        # mundo do link -> o nosso
inv  = tr.Inverse
cs   = tr.ToCoordinateSystem()

def scatola(el, t=None):
    bb = el.get_BoundingBox(None)
    if bb is None:
        return None
    if t is None:
        return (bb.Min.X, bb.Min.Y, bb.Min.Z,
                bb.Max.X, bb.Max.Y, bb.Max.Z)
    xs, ys, zs = [], [], []
    for x in (bb.Min.X, bb.Max.X):
        for y in (bb.Min.Y, bb.Max.Y):
            for z in (bb.Min.Z, bb.Max.Z):
                p = t.OfPoint(XYZ(x, y, z))
                xs.append(p.X); ys.append(p.Y); zs.append(p.Z)
    return (min(xs), min(ys), min(zs), max(xs), max(ys), max(zs))

def si_toccano(a, b, g=0.5):           # folga em pés (~15 cm)
    return (a[0]-g <= b[3] and b[0]-g <= a[3] and
            a[1]-g <= b[4] and b[1]-g <= a[4] and
            a[2]-g <= b[5] and b[2]-g <= a[5])

# as caixas dos eletrodutos escolhidos, levadas ao mundo do link
scatole = [s for s in (scatola(el, inv) for el in scelti) if s]

CATEGORIE = [BuiltInCategory.OST_Walls,
             BuiltInCategory.OST_Floors,
             BuiltInCategory.OST_StructuralFraming]
solidi, scartati = [], 0
for cat in CATEGORIE:
    for el in (FilteredElementCollector(ldoc).OfCategory(cat)
               .WhereElementIsNotElementType()):
        b = scatola(el)
        if b is None or not any(si_toccano(a, b) for a in scatole):
            continue                   # longe: não se converte
        for g in el.get_Geometry(Options()):
            pezzi = (g.GetInstanceGeometry()
                     if isinstance(g, GeometryInstance) else [g])
            for s in pezzi:
                if isinstance(s, Solid) and s.Volume > 1e-6:
                    # algumas faces não sobrevivem à
                    # conversão Revit -> Dynamo: são puladas
                    try:
                        solidi.append(
                            s.ToProtoType().Transform(cs))
                    except Exception:
                        scartati += 1
OUT = solidi
# ----------------------------------------

# group: 3 - O clash: sólido contra sólido
intersect = Geometry.Intersect(geometry=geometry, other=as_estruturas_próximas_python, lacing=CrossProduct)
os_volumes_do_clash = CodeBlock(inter=intersect) { List.Clean(List.Flatten(inter, -1), false); }

# group: 4 - A colocação para a coordenação
categories = Categories("OST_GenericModel")
o_nome_da_directshape = CodeBlock { "Clash eletroduto"; }
byGeometry = DirectShape.ByGeometry(geometry=os_volumes_do_clash, category=categories, name=o_nome_da_directshape)
count = List.Count(list=byGeometry)
clashes_encontrados = Watch(count)
