# Dynamo graph codice-8-1-dynamo.dyn "codice-7-1-dynamo" (Dynamo 3.3.0.6316)
# packages: archi-lab.net 2025.300.1225

pick_model_elements = DSModelElementMultipleSelection()  # 7 picked in the model
location = archilab.Revit.Elements.Elements.Location(element=pick_model_elements)
isNull = Object.IsNull(object=location.Line)
filterByBoolMask = List.FilterByBoolMask(list=pick_model_elements, mask=isNull)
code_block = CodeBlock { "Length"; }
getParameterValueByName = Element.GetParameterValueByName(element=filterByBoolMask.out, parameterName=code_block)
sum = Math.Sum(values=getParameterValueByName)
code_block_2 = CodeBlock { "Angle"; }
getParameterValueByName_2 = Element.GetParameterValueByName(element=filterByBoolMask.in, parameterName=code_block_2)
code_block_3 = CodeBlock { "Bend Radius"; }
getParameterValueByName_3 = Element.GetParameterValueByName(element=filterByBoolMask.in, parameterName=code_block_3)
arco_raggio_x_angolo_rad = CodeBlock(angolo_gradi=getParameterValueByName_2, raggio=getParameterValueByName_3) { angolo_gradi * (raggio * Math.PI / 180); }
sum_2 = Math.Sum(values=arco_raggio_x_angolo_rad)
add = sum + sum_2
