# Dynamo graph codice-8-2-dynamo.dyn "cap-7-2-riempimento" (Dynamo 2.13.1.3887)
# Grafo do capítulo sobre a taxa de ocupação dos eletrodutos, todo em nós nativos: diâmetro interno, lista dos cabos a partir dos parâmetros de projeto, áreas, verificação CEI 64-8 e cor do resultado na vista.

select_model_element = DSModelElementSelection()  # nothing selected
code_block = CodeBlock { "Inside Diameter"; }
getParameterValueByName = Element.GetParameterValueByName(element=select_model_element, parameterName=code_block)
watch = Watch(getParameterValueByName)
code_block_2 = CodeBlock { nomi = ["FG16R16 120", "FG16R16 240"]; diam = [22.4, 30.4]; }
getParameterValueByName_2 = Element.GetParameterValueByName(element=select_model_element, parameterName=code_block_2.nomi)
watch_2 = Watch(getParameterValueByName_2)
code_block_3 = CodeBlock { fattore = 25.4; }
code_block_4 = CodeBlock(deRaw=getParameterValueByName, fattore=code_block_3, diam=code_block_2.diam, q=getParameterValueByName_2)
# ---------- code_block_4.designscript (6 lines) ----------
De = deRaw * fattore;
sommaD2 = Math.Sum(Math.Pow(diam, 2) * q);
Atubo = Math.PI / 4 * Math.Pow(De, 2);
Acavi = Math.PI / 4 * sommaD2;
K = Acavi / Atubo;
Dt = Math.Sqrt(sommaD2);
# ----------------------------------------
code_block_5 = CodeBlock(Dt=code_block_4.Dt, De=code_block_4.De, K=code_block_4.K)
# ---------- code_block_5.designscript (13 lines) ----------
Demin = 1.3 * Dt;
norma = De >= Demin;
prassi = K <= 0.40;
esito = norma ? (prassi ? "CONFORME" : "NO LIMITE") : "NÃO CONFORME";
colore = norma
    ? (prassi ? Color.ByARGB(255, 0, 150, 60)
              : Color.ByARGB(255, 235, 160, 0))
    : Color.ByARGB(255, 200, 30, 30);
report = ["De mm = " + Math.Round(De, 1),
          "Ocupação % = " + Math.Round(K * 100, 1),
          "Dt mm = " + Math.Round(Dt, 1),
          "min 1,3 x Dt mm = " + Math.Round(Demin, 1),
          "RESULTADO: " + esito];
# ----------------------------------------
watch_3 = Watch(code_block_5.report)
overrideColorInView = Element.OverrideColorInView(element=select_model_element, color=code_block_5.colore)
