# Dynamo graph codice-8-3-dynamo.dyn "cap-7-1-staffaggio" (Dynamo 2.13.1.3887)
# Grafo do capítulo 8.3 (suportação): leitura, cálculo e gravação dos suportes.

select_model_element = DSModelElementSelection()  # nothing selected
code_block = CodeBlock { "Length"; ["FG16 4G95","FG16 5G16","FG16 3G2.5"]; }
getParameterValueByName = Element.GetParameterValueByName(element=select_model_element, parameterName=code_block.out0)
getParameterValueByName_2 = Element.GetParameterValueByName(element=select_model_element, parameterName=code_block.out1)
python_script = Python(IN[0]=getParameterValueByName, IN[1]=getParameterValueByName_2)  # CPython3
# ---------- python_script.python (21 lines) ----------
# Cap. 8.3 - Cálculo dos suportes (support spacing)
import math

# --- entradas do grafo ---
L   = IN[0]           # comprimento do trecho (m)
qta = IN[1]           # [n1, n2, n3] quantidades de cabos lidas do modelo

# --- dados de projeto (catálogo) ---
w_pass  = 5.00                 # kg/m, peso próprio da eletrocalha
pesi    = [4.10, 1.35, 0.18]   # kg/m para FG16 4G95 / 5G16 / 3G2.5
i       = 1.50                 # m, espaçamento de projeto
portata = 152.9                # kg, capacidade do suporte 41/600 (1500 N)

# --- cálculo ---
w = w_pass + sum(p * n for p, n in zip(pesi, qta))   # peso por metro
F = w * i                                            # carga no suporte interno
N = int(math.ceil(L / i)) + 1                        # número de suportes
esito = "CONFORME" if F <= portata else "NÃO CONFORME"

# --- saída: [número de suportes, espaçamento] ---
OUT = [N, i]
# ----------------------------------------
code_block_2 = CodeBlock(OUT=python_script) { OUT[0]; OUT[1]; }
watch = Watch(code_block_2.out0)
code_block_3 = CodeBlock { "Qtd suportes"; "Espaçamento suportes"; }
setParameterByName = Element.SetParameterByName(element=select_model_element, parameterName=code_block_3.out0, value=code_block_2.out0, lacing=Longest)
setParameterByName_2 = Element.SetParameterByName(element=select_model_element, parameterName=code_block_3.out1, value=code_block_2.out1, lacing=Longest)
